# Grasshopper definition Example File.gh (Grasshopper 1.0.7)
# Copyright: 2020
# plug-ins: DefaultPanel

# Mathias Sønderskov 2020
panel = Panel("www.github.com/sonderwoods/DefaultPanel")
default_me = Button()
default = Panel("3")
default_2 = Panel("25")
default_3 = Default(DefaultText=default, Reset=default_me, targetPanelComponentGuid=radius)
# Use the button to reset the panels.
# Currently there is not a undo-step,
# so use with caution!
default_4 = Default(DefaultText=default_2, Reset=default_me, targetPanelComponentGuid=length)
radius = Panel("4")
length = Panel("40")
xy = XYPlane(Origin=Point(0, 0, 0))
cyl = Cylinder(Base=xy, Radius=radius, Length=length)
